# Dynamo graph Quiosque.dyn (Dynamo 2.13.1.3887)

# group: Definição do ponto inicial
# ponto de referência inicial da modelagem
byCoordinates = Point.ByCoordinates()

# group: Parâmetros de entrada
raio_da_edificação = DoubleSlider(6, range=3..6 step 0.5)
número_de_lados = IntegerSlider(9, range=3..12 step 1)
altura_da_cobertura = DoubleSlider(3.25, range=2.5..4 step 0.25)
profundidade_da_fundação = DoubleSlider(-1.5, range=-1.5..-0.5 step 0.25)
inclinação_da_cobertura = DoubleSlider(0.35, range=0.2..0.35 step 0.05)
material_pilar_e_vigas_cobertura = IntegerSlider(2, range=1..2 step 1)  # "Material pilar e vigas cobertura: 1 - concreto; 2 - madeira"
intensidade_carga_1_baixo_2_alto = IntegerSlider(2, range=1..2 step 1)
material_fundação_1_concreto_2 = IntegerSlider(1, range=1..2 step 1)  # "Material fundação: 1 - concreto; 2 - madeira"
material_terças_1_concreto_2 = IntegerSlider(2, range=1..2 step 1)  # "Material Terças: 1 - concreto; 2 - madeira"
carregamento_pilar_kn_m2 = CodeBlock { 1; }
forma_r_m2_concreto_r_m3_madeira = CodeBlock { 131.41; 676.70; 2000; 11.79; }  # "forma(R$/m2); concreto(R$/m3); madeira(R$/m3); aço(R$/kg)"

# group: Definição da circunferência
byCenterPointRadius = Circle.ByCenterPointRadius(centerPoint=byCoordinates, radius=raio_da_edificação)

# group: Modelo de linhas da base
regularPolygon = Polygon.RegularPolygon(circle=byCenterPointRadius, numberSides=número_de_lados)
points = Polygon.Points(polygon=regularPolygon)
explode = Geometry.Explode(geometry=regularPolygon)

# group: Linha e ponto de referência da cobertura
pontos_cobertura = Geometry.Translate(geometry=points, zTranslation=altura_da_cobertura)
linhas_cobertura = Geometry.Translate(geometry=explode, zTranslation=altura_da_cobertura)

# group: Pontos da fundação
pontos_fundação = Geometry.Translate(geometry=points, zTranslation=profundidade_da_fundação)

# group: Linhas de referência para pilares
linhas_pilares = Line.ByStartPointEndPoint(startPoint=points, endPoint=pontos_cobertura)
linhas_pilares_fundação = Line.ByStartPointEndPoint(startPoint=pontos_fundação, endPoint=points)

# group: Atribuição de famílias de pilares
levels = Levels("Nível 1")
family_types = FamilyTypes("M_Concrete-Rectangular-Column:Pilar")
columnByCurve = StructuralFraming.ColumnByCurve(curve=linhas_pilares, level=levels, structuralColumnType=family_types)
family_types_2 = FamilyTypes("M_Concrete-Rectangular-Column:Pilar fundação")
columnByCurve_2 = StructuralFraming.ColumnByCurve(curve=linhas_pilares_fundação, level=levels, structuralColumnType=family_types_2)

code_block = CodeBlock(Raio=raio_da_edificação, Inclinacao=inclinação_da_cobertura, Altura=altura_da_cobertura) { (Raio * Inclinacao) + Altura; }

# group: Ponto da cobertura
translate = Geometry.Translate(geometry=byCoordinates, zTranslation=code_block)

# group: Terças da cobertura
byStartPointEndPoint = Line.ByStartPointEndPoint(startPoint=translate, endPoint=pontos_cobertura)

# group: Atribuição de famílias de vigas
levels_2 = Levels("Nível 1")
family_types_3 = FamilyTypes("M_Concrete-Rectangular Beam:Viga baldrame")
vigas_baldrames = StructuralFraming.BeamByCurve(curve=explode, level=levels_2, structuralFramingType=family_types_3)
family_types_4 = FamilyTypes("M_Concrete-Rectangular Beam:Terças cobertura")
terças = StructuralFraming.BeamByCurve(curve=byStartPointEndPoint, level=levels_2, structuralFramingType=family_types_4)
family_types_5 = FamilyTypes("M_Concrete-Rectangular Beam:Viga cobertura")
vigas_cobertura = StructuralFraming.BeamByCurve(curve=linhas_cobertura, level=levels_2, structuralFramingType=family_types_5)

watch = Watch(family_types_5)

# group: Pré-dimensionamento de vigas da cobertura
length = Curve.Length(curve=explode)
average = Math.Average(numbers=length)
calculo_de_altura_da_viga = Python(IN[0]=average, IN[1]=material_pilar_e_vigas_cobertura, IN[2]=intensidade_carga_1_baixo_2_alto)  # CPython3
# ---------- calculo_de_altura_da_viga.python (18 lines) ----------
vao = IN[0]
material = IN[1]
intensidade_de_carga = IN[2]

#1 - Concreto e 2 - Madeira
if material == 1:
    #1 - carga baixa e 2 - carga alta
    if intensidade_de_carga == 1:
        altura_viga = vao * 0.08
    elif intensidade_de_carga == 2:
        altura_viga = vao * 0.1
elif material == 2:
    if intensidade_de_carga == 1:
        altura_viga = vao * 0.1
    elif intensidade_de_carga == 2:
        altura_viga = vao * 0.12
        
OUT = altura_viga
# ----------------------------------------
calculo_da_base_da_viga = Python(IN[0]=calculo_de_altura_da_viga)  # CPython3
# ---------- calculo_da_base_da_viga.python (3 lines) ----------
altura_viga = IN[0]

OUT = altura_viga * (2/3)
# ----------------------------------------

# group: Definição da seção estrutural Viga da cobertura
string = StringInput("h")
setParameterByName = Element.SetParameterByName(element=watch, parameterName=string, value=calculo_de_altura_da_viga)
string_2 = StringInput("b")
setParameterByName_2 = Element.SetParameterByName(element=watch, parameterName=string_2, value=calculo_da_base_da_viga)

watch_2 = Watch(family_types_3)

# group: Pré-dimensionamento de vigas baldrame
length_2 = Curve.Length(curve=explode)
average_2 = Math.Average(numbers=length_2)
calculo_de_altura_da_viga_2 = Python(IN[0]=average_2, IN[1]=material_fundação_1_concreto_2, IN[2]=intensidade_carga_1_baixo_2_alto)  # CPython3; same code as calculo_de_altura_da_viga
calculo_da_base_da_viga_2 = Python(IN[0]=calculo_de_altura_da_viga_2)  # CPython3; same code as calculo_da_base_da_viga

# group: Definição da seção estrutural Viga baldrame
string_3 = StringInput("h")
setParameterByName_3 = Element.SetParameterByName(element=watch_2, parameterName=string_3, value=calculo_de_altura_da_viga_2)
string_4 = StringInput("b")
setParameterByName_4 = Element.SetParameterByName(element=watch_2, parameterName=string_4, value=calculo_da_base_da_viga_2)

watch_3 = Watch(family_types_4)

# group: Pré-dimensionamento de terças
length_3 = Curve.Length(curve=explode)
average_3 = Math.Average(numbers=length_3)
calculo_de_altura_da_viga_3 = Python(IN[0]=average_3, IN[1]=material_terças_1_concreto_2, IN[2]=intensidade_carga_1_baixo_2_alto)  # CPython3; same code as calculo_de_altura_da_viga
calculo_da_base_da_viga_3 = Python(IN[0]=calculo_de_altura_da_viga_3)  # CPython3; same code as calculo_da_base_da_viga

# group: Definição da seção estrutural Terça da cobertura
string_5 = StringInput("b")
setParameterByName_5 = Element.SetParameterByName(element=watch_3, parameterName=string_5, value=calculo_da_base_da_viga_3)
string_6 = StringInput("h")
setParameterByName_6 = Element.SetParameterByName(element=watch_3, parameterName=string_6, value=calculo_de_altura_da_viga_3)

# group: Pré-dimensionamento do pilar
python_script = Python(IN[0]=raio_da_edificação, IN[1]=average_2, IN[2]=carregamento_pilar_kn_m2, IN[3]=material_pilar_e_vigas_cobertura)  # CPython3
# ---------- python_script.python (25 lines) ----------
import math

raio = IN[0]
lado = IN[1]
carga_do_piso = IN[2]
material = IN[3]


# Equação para definir o valor da apótema. Distancia ortogonal do centro ao lado do polígono
apotema = math.sqrt((raio ** 2) - ((lado ** 2)/4))

#pilares de concreto
area_de_influencia = (lado * apotema)/2
#carga sobre pilar
carga_no_pilar = (area_de_influencia * carga_do_piso)

#condicional de calculo da seção
#considerar unidade de peso em kgf/cm²
if material == 1:
    area_da_secao = carga_no_pilar/100
elif material == 2:
    area_da_secao = carga_no_pilar/60


OUT = math.sqrt(area_da_secao)
# ----------------------------------------

watch_4 = Watch(python_script)

# group: Definição da seção estrutural pilar
string_7 = StringInput("h")
setParameterByName_7 = Element.SetParameterByName(element=family_types, parameterName=string_7, value=watch_4)
string_8 = StringInput("b")
setParameterByName_8 = Element.SetParameterByName(element=family_types, parameterName=string_8, value=watch_4)

# group: Pré-dimensionamento do pilar fundação
python_script_2 = Python(IN[0]=raio_da_edificação, IN[1]=average_2, IN[2]=carregamento_pilar_kn_m2, IN[3]=material_fundação_1_concreto_2)  # CPython3; same code as python_script

watch_5 = Watch(python_script_2)

# group: Definição da seção estrutural pilar da fundação
string_9 = StringInput("h")
setParameterByName_9 = Element.SetParameterByName(element=family_types_2, parameterName=string_9, value=watch_5)
string_10 = StringInput("b")
setParameterByName_10 = Element.SetParameterByName(element=family_types_2, parameterName=string_10, value=watch_5)

área_do_quiosque = Python(IN[0]=raio_da_edificação, IN[1]=average_2, IN[2]=número_de_lados)  # CPython3
# ---------- área_do_quiosque.python (18 lines) ----------
import math

raio = IN[0]
lado = IN[1]
quant_lados = IN[2]



# Equação para definir o valor da apótema. Distancia ortogonal do centro ao lado do polígono
apotema = math.sqrt((raio ** 2) - ((lado ** 2)/4))

#perímetro
perimetro = quant_lados * lado

#area
area = apotema * (perimetro/2)

OUT = area
# ----------------------------------------
watch_6 = Watch(family_types_2)

# group: Extração de dados pilar fundação
all_elements_of_family_type = ElementsOfFamilyType(Family_Type=watch_6)
code_block_2 = CodeBlock { "Comprimento"; "Volume"; "b"; "h"; }
getParameterValueByName = Element.GetParameterValueByName(element=all_elements_of_family_type, parameterName=code_block_2.out1)
average_4 = Math.Average(numbers=getParameterValueByName)
volume = Watch(average_4)
getParameterValueByName_2 = Element.GetParameterValueByName(element=all_elements_of_family_type, parameterName=code_block_2.out0)
average_5 = Math.Average(numbers=getParameterValueByName_2)
comprimento = Watch(average_5)
getParameterValueByName_3 = Element.GetParameterValueByName(element=watch_6, parameterName=code_block_2.out2)
average_6 = Math.Average(numbers=getParameterValueByName_3)
lado_do_pilar = Watch(average_6)
getParameterValueByName_4 = Element.GetParameterValueByName(element=watch_6, parameterName=code_block_2.out3)
average_7 = Math.Average(numbers=getParameterValueByName_4)
lado_do_pilar_2 = Watch(average_7)

watch_7 = Watch(family_types_3)

# group: Extração de dados de vigas baldrames
all_elements_of_family_type_2 = ElementsOfFamilyType(Family_Type=watch_7)
code_block_3 = CodeBlock { "Comprimento"; "Volume"; "b"; "h"; }
getParameterValueByName_5 = Element.GetParameterValueByName(element=all_elements_of_family_type_2, parameterName=code_block_3.out1)
average_8 = Math.Average(numbers=getParameterValueByName_5)
volume_2 = Watch(average_8)
getParameterValueByName_6 = Element.GetParameterValueByName(element=all_elements_of_family_type_2, parameterName=code_block_3.out0)
average_9 = Math.Average(numbers=getParameterValueByName_6)
comprimento_2 = Watch(average_9)
getParameterValueByName_7 = Element.GetParameterValueByName(element=watch_7, parameterName=code_block_3.out2)
base = Watch(getParameterValueByName_7)
getParameterValueByName_8 = Element.GetParameterValueByName(element=watch_7, parameterName=code_block_3.out3)
altura = Watch(getParameterValueByName_8)

# group: Volume de material (concreto) fundação
python_script_3 = Python(IN[0]=número_de_lados, IN[1]=volume, IN[2]=volume_2)  # CPython3
# ---------- python_script_3.python (7 lines) ----------
quantidade_elementos = IN[0]
volume_pilar = IN[1]
volume_viga = IN[2]

volume = (volume_viga * quantidade_elementos) + (volume_pilar * quantidade_elementos)

OUT = volume
# ----------------------------------------

watch_8 = Watch(family_types)

# group: Extração de dados pilar
all_elements_of_family_type_3 = ElementsOfFamilyType(Family_Type=watch_8)
code_block_4 = CodeBlock { "Comprimento"; "Volume"; "b"; "h"; }
getParameterValueByName_9 = Element.GetParameterValueByName(element=all_elements_of_family_type_3, parameterName=code_block_4.out1)
average_10 = Math.Average(numbers=getParameterValueByName_9)
volume_de_pilar = Watch(average_10)
getParameterValueByName_10 = Element.GetParameterValueByName(element=all_elements_of_family_type_3, parameterName=code_block_4.out0)
average_11 = Math.Average(numbers=getParameterValueByName_10)
comprimento_do_pilar = Watch(average_11)
getParameterValueByName_11 = Element.GetParameterValueByName(element=watch_8, parameterName=code_block_4.out2)
average_12 = Math.Average(numbers=getParameterValueByName_11)
lado_do_pilar_3 = Watch(average_12)
getParameterValueByName_12 = Element.GetParameterValueByName(element=watch_8, parameterName=code_block_4.out3)
average_13 = Math.Average(numbers=getParameterValueByName_12)
lado_do_pilar_4 = Watch(average_13)

watch_9 = Watch(family_types_5)

# group: Extração de dados de vigas da cobertura
all_elements_of_family_type_4 = ElementsOfFamilyType(Family_Type=watch_9)
code_block_5 = CodeBlock { "Comprimento"; "Volume"; "b"; "h"; }
getParameterValueByName_13 = Element.GetParameterValueByName(element=all_elements_of_family_type_4, parameterName=code_block_5.out1)
average_14 = Math.Average(numbers=getParameterValueByName_13)
volume_3 = Watch(average_14)
getParameterValueByName_14 = Element.GetParameterValueByName(element=all_elements_of_family_type_4, parameterName=code_block_5.out0)
average_15 = Math.Average(numbers=getParameterValueByName_14)
comprimento_3 = Watch(average_15)
getParameterValueByName_15 = Element.GetParameterValueByName(element=watch_9, parameterName=code_block_5.out2)
base_2 = Watch(getParameterValueByName_15)
getParameterValueByName_16 = Element.GetParameterValueByName(element=watch_9, parameterName=code_block_5.out3)
altura_2 = Watch(getParameterValueByName_16)

# group: Volume de material pilares e vigas
python_script_4 = Python(IN[0]=material_pilar_e_vigas_cobertura)  # CPython3
# ---------- python_script_4.python (4 lines) ----------
if IN[0]==1:
    OUT = True
else:
    OUT = False
# ----------------------------------------
python_script_5 = Python(IN[0]=número_de_lados, IN[1]=volume_de_pilar, IN[2]=volume_3)  # CPython3; same code as python_script_3
code_block_6 = CodeBlock { 0; }
volume_de_concreto_pilar_e_vigas = RefactoredIf(test=python_script_4, true=python_script_5, false=code_block_6)  # "Volume de concreto - Pilar e vigas cobertura"
volume_de_madeira_pilar_e_vigas = RefactoredIf(test=python_script_4, true=code_block_6, false=python_script_5)  # "Volume de madeira - Pilar e vigas cobertura"

watch_10 = Watch(family_types_4)

# group: Extração de dados de terças da cobertura
all_elements_of_family_type_5 = ElementsOfFamilyType(Family_Type=watch_10)
code_block_7 = CodeBlock { "Comprimento"; "Volume"; "b"; "h"; }
getParameterValueByName_17 = Element.GetParameterValueByName(element=all_elements_of_family_type_5, parameterName=code_block_7.out1)
average_16 = Math.Average(numbers=getParameterValueByName_17)
volume_4 = Watch(average_16)
getParameterValueByName_18 = Element.GetParameterValueByName(element=all_elements_of_family_type_5, parameterName=code_block_7.out0)
average_17 = Math.Average(numbers=getParameterValueByName_18)
comprimento_da_viga = Watch(average_17)
getParameterValueByName_19 = Element.GetParameterValueByName(element=watch_10, parameterName=code_block_7.out2)
base_3 = Watch(getParameterValueByName_19)
getParameterValueByName_20 = Element.GetParameterValueByName(element=watch_10, parameterName=code_block_7.out3)
altura_3 = Watch(getParameterValueByName_20)

# group: Volume de material terças
python_script_6 = Python(IN[0]=material_terças_1_concreto_2)  # CPython3; same code as python_script_4
python_script_7 = Python(IN[0]=número_de_lados, IN[1]=volume_4)  # CPython3
# ---------- python_script_7.python (6 lines) ----------
quantidade_elementos = IN[0]
volume_viga = IN[1]

volume = (volume_viga * quantidade_elementos)

OUT = volume
# ----------------------------------------
code_block_8 = CodeBlock { 0; }
volume_de_concreto_pilar_e_vigas_2 = RefactoredIf(test=python_script_6, true=python_script_7, false=code_block_8)  # "Volume de concreto - Pilar e vigas cobertura"
volume_de_madeira_pilar_e_vigas_2 = RefactoredIf(test=python_script_6, true=code_block_8, false=python_script_7)  # "Volume de madeira - Pilar e vigas cobertura"

# group: Volume de concreto
volume_de_concreto = CodeBlock(a=python_script_3, b=volume_de_concreto_pilar_e_vigas, c=volume_de_concreto_pilar_e_vigas_2) { a+b+c; }

# group: Calculo total de formas
calculo_de_formas_dos_pilares_e = Python(IN[0]=comprimento_3, IN[1]=base_2, IN[2]=altura_2, IN[3]=comprimento_do_pilar, IN[4]=lado_do_pilar_3, IN[5]=número_de_lados, IN[6]=número_de_lados, IN[7]=material_pilar_e_vigas_cobertura, IN[8]=material_pilar_e_vigas_cobertura)  # "Calculo de formas dos pilares e vigas da cobertura"; CPython3
# ---------- calculo_de_formas_dos_pilares_e.python (36 lines) ----------
comprimento_viga = IN[0]
base_viga = IN[1]
altura_viga = IN[2]

comprimento_pilar = IN[3]
lado_pilar = IN[4]

quantidade_de_pilares = IN[5]
quantidade_de_vigas = IN[6]

material_pilares = IN[7]
material_viga = IN[8]

#área de

#Calculo de forma das vigas
if material_viga == 1:
    forma_viga = ((base_viga + (altura_viga * 2)) * comprimento_viga) * quantidade_de_vigas
else:
    forma_viga = 0

#calculo de forma dos pilares
if material_pilares == 1:
    forma_pilar = ((lado_pilar * 4) * comprimento_pilar) * quantidade_de_pilares
else:
    forma_pilar = 0

#quantidade total de formas
total_forma = forma_pilar + forma_viga






OUT = total_forma
# ----------------------------------------
watch_11 = Watch(calculo_de_formas_dos_pilares_e)
calculo_de_formas_da_fundação = Python(IN[0]=comprimento_2, IN[1]=base, IN[2]=altura, IN[3]=comprimento, IN[4]=lado_do_pilar, IN[5]=número_de_lados, IN[6]=número_de_lados, IN[7]=material_fundação_1_concreto_2, IN[8]=material_fundação_1_concreto_2)  # CPython3; same code as calculo_de_formas_dos_pilares_e
watch_12 = Watch(calculo_de_formas_da_fundação)
calculo_de_formas_das_terças = Python(IN[0]=comprimento_da_viga, IN[1]=base_3, IN[2]=altura_3, IN[3]=número_de_lados, IN[4]=material_terças_1_concreto_2)  # CPython3
# ---------- calculo_de_formas_das_terças.python (22 lines) ----------
comprimento_viga = IN[0]
base_viga = IN[1]
altura_viga = IN[2]

quantidade_de_vigas = IN[3]

material_viga = IN[4]

#área de

#Calculo de forma das vigas
if material_viga == 1:
    forma_viga = ((base_viga + (altura_viga * 2)) * comprimento_viga) * quantidade_de_vigas
else:
    forma_viga = 0
    

#quantidade total de formas
total_forma = forma_viga


OUT = total_forma
# ----------------------------------------
watch_13 = Watch(calculo_de_formas_das_terças)
área_de_forma = CodeBlock(a=watch_11, b=watch_12, c=watch_13) { a+b+c; }

# group: Peso de aço
peso_de_aço = CodeBlock(a=volume_de_concreto) { a*100; }

# group: Volume de madeira
volume_de_madeira = CodeBlock(a=volume_de_madeira_pilar_e_vigas, b=volume_de_madeira_pilar_e_vigas_2) { a+b; }

custo_total_do_projeto = Python(IN[0]=área_de_forma, IN[1]=volume_de_concreto, IN[2]=peso_de_aço, IN[3]=volume_de_madeira, IN[4]=forma_r_m2_concreto_r_m3_madeira.out0, IN[5]=forma_r_m2_concreto_r_m3_madeira.out1, IN[6]=forma_r_m2_concreto_r_m3_madeira.out2, IN[7]=forma_r_m2_concreto_r_m3_madeira.out3)  # CPython3
# ---------- custo_total_do_projeto.python (16 lines) ----------
area_de_forma = IN[0]
volume_de_concreto = IN[1]
peso_de_aco = IN[2]
volume_de_madeira = IN[3]

custo_forma = IN[4]
custo_concreto = IN[5]
custo_madeira = IN[6]
custo_aco = IN[7]

#calculo do custo total
custo_total = (area_de_forma * custo_forma) + (volume_de_concreto * custo_concreto) + (custo_madeira * volume_de_madeira) + (peso_de_aco * custo_aco)


#Atribuição a variável de saída
OUT = custo_total
# ----------------------------------------

# group: Organizar dados para escrita
list_create = List.Create(item0=raio_da_edificação, item1=número_de_lados, item2=altura_da_cobertura, item3=profundidade_da_fundação, item4=inclinação_da_cobertura, item5=área_do_quiosque, item6=intensidade_carga_1_baixo_2_alto, item7=carregamento_pilar_kn_m2, item8=material_pilar_e_vigas_cobertura, item9=material_fundação_1_concreto_2, item10=material_terças_1_concreto_2, item11=volume_de_concreto, item12=área_de_forma, item13=peso_de_aço, item14=volume_de_madeira, item15=custo_total_do_projeto)
code_block_9 = CodeBlock { 1; }
chop = List.Chop(list=list_create, lengths=code_block_9)
transpose = List.Transpose(lists=chop)
watch_14 = Watch(transpose)

# group: Identificar a quantidade de linhas da planilha
file_path = Filename(".\extracaoDeDados.xlsx")
file_from_path = FileObject(path=file_path)
code_block_10 = CodeBlock { "dados"; }
importExcel = Data.ImportExcel(file=file_from_path, sheetName=code_block_10)
watch_15 = Watch(importExcel)

# group: Escrever no excel
file_path_2 = Filename(".\extracaoDeDados.xlsx")
string_11 = StringInput("dados")
count = List.Count(list=importExcel)
code_block_11 = CodeBlock { 1; }
exportToExcel = Data.ExportToExcel(filePath=file_path_2, sheetName=string_11, startRow=count, startColumn=code_block_11, data=transpose)

code_block_12 = CodeBlock { "Fazer - organizar parâmetros de entrada"; }
code_block_13 = CodeBlock { "Fazer - dividir pré-dimensionamento"; }
code_block_14 = CodeBlock { "Fazer - dividir pré-dimensionamento"; }
watch_16 = Watch(list_create)
